# Grasshopper definition HoloFab_Example_HoloBot_User-Interface.gh (Grasshopper 1.0.7)
# plug-ins: HoloFab

ip_address_of_ar_device = Panel("127.0.0.1")
C = CreateConnection(Address=ip_address_of_ar_device, Send=Toggle(False))
ui = UIReceiver(Connect=C)  # -> Toggles, Counters, Sliders

# ---- group: Isolating first 6 values from the sliders in AR device
split = SplitList(List=ui.Sliders, Index="5")  # -> ListA, ListB

# ---- group: Isolating first boolean value
item = ListItem(List=ui.Toggles, Index=0, Wrap=True)

# ---- group: Other Purposes
item_2 = ListItem(List=split.ListB, Index=0, Wrap=True)

# ---- group: Axis Limits for ABB robot: IRB140
axis_1 = Slider(0, range=-180..180)
axis_2 = Slider(0, range=-90..110)
axis_3 = Slider(50, range=-230..50)
axis_4 = Slider(100, range=-200..200)
axis_5 = Slider(0, range=-115..115)
axis_6 = Slider(0, range=-400..400)

# ---- group: Creating a HoloBot
robot = ValueList({"Choose Robot", "KR150-2_110", "IRB140", "IRB120"}, selected="Choose Robot")
hb = HoloBot(Name=robot, ID=0, Plane=PlaneXY(0, 0, 0))

# ---- group: Axis Values
item_3 = ListItem(List=split.ListA, Index=0, Wrap=True)

# ----
axis_limit = Panel("""-180 To 180
-90 To 110
-230 To 50
-200 To 200
-115 To 115
-400 To 400""")
merge = Merge(Data1=axis_1, Data2=axis_2, Data3=axis_3, Data4=axis_4, Data5=axis_5, Data6=axis_6)
remap = RemapNumbers(Value=item_3, Source=Domain(0, 1), Target=axis_limit)  # -> Mapped, Clipped
filter = StreamFilter(Gate=item, Stream0=merge, Stream1=remap.Mapped)

# ---- group: Send HoloBot(s) to AR environment
rs = RobotStreaming(HoloBotS=hb, Connect=C)

# ---- group: Send axis values to Holobot(s)
rc = RobotController(HoloBot=hb, AxisValues=filter, Connect=C)
