# Grasshopper definition HoloFab_Example_FireFly_Sound.gh (Grasshopper 1.0.7)
# plug-ins: Heteroptera, Firefly.X, HoloFab, Firefly.Core

# ---- group: ENABLE TO START
ip_address = Panel("192.168.1.137")
create_connection = CreateConnection(Address=ip_address)
timer = Timer(TimerInterval=100, Target=[sound_capture, seed_generator])  # disabled
activation = BooleanToggle(False)

# ---- group: Inputs
bump_max_size = Slider(200, range=0..1000)
points_to_move_percentage = Slider(0.5, range=0..1)
sphere_radius = Slider(300, range=0..1000)
sphere_height = Slider(468, range=0..1000)

# ----
measurement_frequency = Slider(0.1, range=0..1)
memory_size = Slider(100, range=0..100)

# ---- group: Extract Volume Info
sound_capture = SoundCapture(TimePeriod=measurement_frequency, StartStopSoundCapture=activation)  # -> WavePressureSamplesFromLeftChannel, WavePressureSamplesFromRightChannel, Volume
# When starting - Wait for the buffer to fill in
buffer = Buffer(Number=sound_capture.Volume, BufferDomain=memory_size)  # -> BufferValues, BufferMinimum, BufferMaximum
current_volume = Panel(sound_capture.Volume)
construct_domain = ConstructDomain(DomainStart=0, DomainEnd=bump_max_size)
construct_domain_2 = ConstructDomain(DomainStart=buffer.BufferMinimum, DomainEnd=buffer.BufferMaximum)
remap_numbers = RemapNumbers(Value=sound_capture.Volume, Source=construct_domain_2, Target=construct_domain)  # -> Mapped, Clipped

# ----
remapped_volume = Panel(remap_numbers.Mapped)
construct_point = ConstructPoint(XCoordinate=0, YCoordinate=0, ZCoordinate=sphere_height)
sphere_center = Point(construct_point)
sphere_radius_2 = Number(sphere_radius)

# ---- group: Result
remapped_volume_2 = Number(remap_numbers.Mapped)

# ----
remapped_volume_3 = Number(remapped_volume_2)

# ---- group: MAke Random Points On wphere move to the beat
mesh_sphere_ex = MeshSphereEx(Base=sphere_center, Radius=sphere_radius, Count="3")
weld_mesh = WeldMesh(Mesh=mesh_sphere_ex, Angle=3.141592654)
deconstruct_mesh = DeconstructMesh(Mesh=weld_mesh)  # -> Vertices, Faces, Colours, Normals
list_length = ListLength(List=deconstruct_mesh.Vertices)
multiplication = Multiplication(A=list_length, B=points_to_move_percentage)
integer = Integer(multiplication)
subtraction = Subtraction(A=list_length, B=integer)
seed_generator = SeedGenerator(Number=1)
duplicate_data = DuplicateData(Data="0", Number=integer, Order=True)
duplicate_data_2 = DuplicateData(Data="1", Number=subtraction, Order=True)
merge = Merge(Data1=duplicate_data, Data2=duplicate_data_2)
jitter = Jitter(List=merge, Jitter=1, Seed=seed_generator)  # -> Values, Indices
sift_pattern = SiftPattern(List=deconstruct_mesh.Vertices, SiftPattern=jitter.Values)  # -> Output0, Output1
sphere_center_2 = Point(sphere_center)
vector_2pt = Vector2Pt(PointA=sphere_center_2, PointB=sift_pattern.Output0, Unitize=False)  # -> Vector, Length
amplitude = Amplitude(Vector=vector_2pt.Vector, Amplitude=remapped_volume_3)
move = Move(Geometry=sift_pattern.Output0, Motion=amplitude)  # -> Geometry, Transform
combine_data = CombineData(Input0=move.Geometry, Input1=sift_pattern.Output1)  # -> Result, Index
construct_mesh = ConstructMesh(Vertices=combine_data.Result, Faces=deconstruct_mesh.Faces)

# ---- group: Result (continued)
mesh = Mesh(construct_mesh)

# ---- group: HOLOFAB
sphere_center_3 = Point(sphere_center)
bump_max_size_2 = Number(bump_max_size)
remapped_volume_4 = Number(remapped_volume_2)
text_size = Slider(28, range=0..100)
colour_swatch = ColourSwatch(SwatchColor=RGB(255, 0, 0))
connection = Data(create_connection)
addition = Addition(A=sphere_radius_2, B=bump_max_size_2)
construct_point_2 = ConstructPoint(XCoordinate=0, YCoordinate=0, ZCoordinate=addition)
addition_2 = Addition(A=sphere_center_3, B=construct_point_2)
xz_plane = XZPlane(Origin=addition_2)
holotag = HoloTag(TextString=remapped_volume_4, TextLocation=xz_plane, TextSize=text_size, TextColor=colour_swatch, Connect=connection)
colour_swatch_2 = ColourSwatch(SwatchColor=RGB(255, 255, 255))
connection_2 = Data(create_connection)
wobling_sphere_mesh = Mesh(mesh)
mesh_streaming = MeshStreaming(Mesh=wobling_sphere_mesh, Color=colour_swatch_2, Connect=connection_2, sourceType=1)

# ----
text_tag_3d = TextTag3D(Location=xz_plane, Text=remapped_volume_4, Size=text_size, Colour=colour_swatch, Justification=5)
custom_preview = CustomPreview(Geometry=wobling_sphere_mesh, Material=colour_swatch_2)
