# Grasshopper definition HoloFab_Example_Kangaroo_Wind.gh (Grasshopper 1.0.7)
# plug-ins: HoloFab, Kangaroo2 Components

# ---- group: Inputs
room_size_x = Slider(1000, range=0..10000)
room_size_y = Slider(1000, range=0..10000)
room_height = Slider(2000, range=0..2000)
wind_strenfth = Slider(1, range=0..1)

# ----
gravity = Slider(10, range=0..100)
negative = Negative(Value=gravity)
unit_z = UnitZ(Factor=negative)
reset = Button()
damping = Slider(0.999, range=0..1)
iterations = Slider(2, range=1..100)
activation = BooleanToggle(True)

# ---- group: HOLOFAB
ip_address = Panel("192.168.1.137")
create_connection = CreateConnection(Address=ip_address)
# Create 1 toggle and 6 sliders
# (4 for corners and 2 for wind direction)
# on AR device
connection = Data(create_connection)
connection_2 = Data(connection)
ui_receiver = UIReceiver(Connect=connection_2)  # -> Toggles, Counters, Sliders
booleans_from_ar = Boolean(ui_receiver.Toggles)
numbers_from_ar = Number(ui_receiver.Sliders)
sliders = Panel(numbers_from_ar)
toggles = Panel(booleans_from_ar)
number_slider = Slider(50, range=0..100)
colour_swatch = ColourSwatch(SwatchColor=RGB(255, 0, 0))
connection_3 = Data(connection)
colour_swatch_2 = ColourSwatch(SwatchColor=RGB(255, 255, 255))
connection_4 = Data(connection)

# ----
numbers_from_ar_2 = Number(numbers_from_ar)
booleans_from_ar_2 = Boolean(booleans_from_ar)
list_item = ListItem(List=booleans_from_ar_2, Index=0, Wrap=True)
wind_activation = Boolean(list_item)
wind_activation_2 = Boolean(wind_activation)
multiplication = Multiplication(A=wind_strenfth, B=wind_activation_2)

# ---- group: Prepare Geometry
division = Division(A=room_size_y, B=2)
division_2 = Division(A=room_size_x, B=2)
negative_2 = Negative(Value=division)
negative_3 = Negative(Value=division_2)
split_list = SplitList(List=numbers_from_ar_2, Index="4")  # -> ListA, ListB
construct_domain = ConstructDomain(DomainStart=negative_2, DomainEnd=division)
construct_domain_2 = ConstructDomain(DomainStart=negative_3, DomainEnd=division_2)
split_list_2 = SplitList(List=split_list.ListB, Index="2")  # -> ListA, ListB
rectangle = Rectangle(Plane=PlaneXY(0, 0, 0), XSize=construct_domain_2, YSize=construct_domain, Radius=0)  # -> Rectangle, Length
remap_numbers = RemapNumbers(Value=split_list.ListA, Source=Domain(0, 1), Target=room_height)  # -> Mapped, Clipped
list_item_2 = ListItem(List=split_list_2.ListA, Index=0, Wrap=True)  # -> Item, Item1
boundary_surfaces = BoundarySurfaces(Edges=rectangle.Rectangle)
explode = Explode(Curve=rectangle.Rectangle, Recursive=True)  # -> Segments, Vertices
vector_xyz = VectorXYZ(XComponent=list_item_2.Item, YComponent=list_item_2.Item1, ZComponent=0)  # -> Vector, Length
unit_z_2 = UnitZ(Factor=remap_numbers.Mapped)
resulution_u = Slider(10, range=0..100)
resolution_v = Slider(10, range=0..100)
mesh_surface = MeshSurface(Surface=boundary_surfaces, UCount=resulution_u, VCount=resolution_v, Overhang=True, Equalize=False)

# ---- group: Wind Preview
construct_point = ConstructPoint(XCoordinate=0, YCoordinate=0, ZCoordinate=0)
multiplication_2 = Multiplication(A=vector_xyz.Vector, B=500)
vector_display = VectorDisplay(Anchor=construct_point, Vector=multiplication_2)

# ----
removeduplicatepts = RemoveDuplicatePts(Points=explode.Vertices, Tolerance=0.01)

# ---- group: Prepare Geometry (continued)
move = Move(Geometry=removeduplicatepts, Motion=unit_z_2)  # -> Geometry, Transform

# ---- group: Result
original_anchor_points = Point(removeduplicatepts)
moved_anchor_points = Point(move.Geometry)
wind_direction = Vector(vector_xyz.Vector)
mesh = Mesh(mesh_surface)

# ---- group: Anchor Preview
moved_anchor_points_2 = Point(moved_anchor_points)
dot_display = DotDisplay(Point=moved_anchor_points_2, Colour=ColourSwatch(SwatchColor=RGB(255, 0, 0)), Size=Slider(10, range=0..100))

# ----
deconstruct_mesh = DeconstructMesh(Mesh=mesh)  # -> Vertices, Faces, Colours, Normals
amplitude = Amplitude(Vector=wind_direction, Amplitude=multiplication)
closest_point = ClosestPoint(Point=original_anchor_points, Cloud=deconstruct_mesh.Vertices)  # -> ClosestPoint, CPIndex, Distance
wind = Wind(Mesh=mesh, WindVector=amplitude)
load = Load(Point=deconstruct_mesh.Vertices, ForceVector=unit_z, Weighting=Slider(5, range=0..10))
edgelengths = EdgeLengths(Mesh=mesh, LengthFactor=Slider(0.5, range=0..1), Strength=Slider(70, range=0..100))
anchor = Anchor(Point=closest_point.ClosestPoint, Target=moved_anchor_points, Strength=10000)
show = Show(G=mesh)
merge = Merge(Data1=show, Data2=anchor, Data3=load, Data4=edgelengths, Data5=wind)
bouncysolver = BouncySolver(GoalObjects=merge, Reset=reset, Threshold=1e-15, Tolerance=0.01, Damping=damping, Iterations=iterations, On=activation)  # -> I, V, O
mesh_2 = Mesh(bouncysolver.O)
clean_tree = CleanTree(RemoveNulls=True, RemoveInvalid=True, RemoveEmpty=invert(False), Tree=mesh_2)

# ---- group: Result (continued)
mesh_3 = Mesh(clean_tree)

# ---- group: HOLOFAB (continued)
moved_anchor_points_3 = Point(moved_anchor_points)
list_length = ListLength(List=moved_anchor_points_3)
series = Series(Start=0, Step=1, Count=list_length)
xz_plane = XZPlane(Origin=moved_anchor_points_3)
holotag = HoloTag(TextString=series, TextLocation=xz_plane, TextSize=number_slider, TextColor=colour_swatch, Connect=connection_3)
kangaroo_mesh = Mesh(mesh_3)
mesh_streaming = MeshStreaming(Mesh=kangaroo_mesh, Color=colour_swatch_2, Connect=connection_4, sourceType=1)

# ----
text_tag_3d = TextTag3D(Location=xz_plane, Text=series, Size=number_slider, Colour=colour_swatch, Justification=7)
custom_preview = CustomPreview(Geometry=kangaroo_mesh, Material=colour_swatch_2)
