# Grasshopper definition HoloFab_Example_MRAC-SimpleDemo.gh (Grasshopper 1.0.7)
# plug-ins: HoloFab

create_connection = CreateConnection(Address="192.168.1.137")
# Create 1 slider
# on AR device
ui_receiver = UIReceiver(Connect=create_connection)  # -> Toggles, Counters, Sliders
panel = Panel(ui_receiver.Toggles)
panel_2 = Panel(ui_receiver.Sliders)
panel_3 = Panel(ui_receiver.Counters)
list_item = ListItem(List=ui_receiver.Sliders, Index=0, Wrap=True)
remap_numbers = RemapNumbers(Value=list_item, Source=Domain(0, 1), Target=Slider(200, range=0..1000))  # -> Mapped, Clipped
number_slider = Slider(267, range=0..1000)
construct_point = ConstructPoint(XCoordinate=0, YCoordinate=0, ZCoordinate=Slider(300, range=0..1000))
mesh_sphere = MeshSphere(Base=PlaneXY(0, 0, 0), Radius=remap_numbers.Mapped, UCount=10, VCount=20)
holotag = HoloTag(
    TextString="Hello MRAC",
    TextLocation=construct_point,
    TextSize=Slider(58, range=0..100),
    TextColor=ColourSwatch(SwatchColor=RGB(255, 0, 0)),
    Connect=create_connection)
mesh_streaming = MeshStreaming(Mesh=mesh_sphere, Color=ColourSwatch(SwatchColor=RGB(255, 255, 255)), Connect=create_connection, sourceType=1)
