# Grasshopper definition HoloFab_Example_Robots_RemoteControl.gh (Grasshopper 1.0.7)
# plug-ins: Robots, treesloth01, HoloFab

gene_pool = GenePool(Decimals=3, Maximum=1, Minimum=0, Value=[0.402, 0.271, 0.394, 0.751, 0.951, 0.755])

# ---- group: Inputs
tool_base_radius = Slider(32, range=0..100)
tool_height = Slider(83, range=0..100)
X = Slider(0, range=-1000..1000)
Y = Slider(500, range=-1000..1000)
Z = Slider(0, range=-1000..1000)
X_2 = Slider(460, range=-1000..1000)
Y_2 = Slider(0, range=-1000..1000)
list = ValueList({"AA-KR60", "AA-KR30", "AA-KR60_KR30", "AARCH IRB120", "AARCH IRB6620", "AAU-Utzon-UR10", "Automata", "Bartlett-IRB120", "Bartlett-IRB1600", "Bartlett-KR6"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}, selected="iaac-IRB120")
list_2 = ValueList({"AA-KR60", "AA-KR30", "AA-KR60_KR30", "AARCH IRB120", "AARCH IRB6620", "AAU-Utzon-UR10", "Automata", "Bartlett-IRB120", "Bartlett-IRB1600", "Bartlett-KR6"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}, selected="iaac-IRB140")
Z_2 = Slider(0, range=-1000..1000)

# ----
joint_values_from_gene_pool = Number(gene_pool)

# ---- group: cREATE tOOL
cone = Cone(Base=PlaneXY(0, 0, 0), Radius=tool_base_radius, Length=tool_height)  # -> Cone, Tip
xy_plane = XYPlane(Origin=cone.Tip)
mesh_brep = MeshBrep(
    Brep=cone.Cone,
    Settings={GridMaxCount=0, GridMinCount=16, JaggedSeams=False, MaxEdgeLength=0, MinEdgeLength=0.0001, MinTolerance=0, Refine=True, RefineAngle=0, RelativeTolerance=0.65, SimplePlanes=True, Tolerance=0})
tool_mesh = Mesh(mesh_brep)
create_tool = CreateTool(Name="DefaultGHTool", TCP=xy_plane, Weight=0, Mesh=tool_mesh)  # -> Tool, TCP

# ----
construct_point = ConstructPoint(XCoordinate=X, YCoordinate=Y, ZCoordinate=Z)
construct_point_2 = ConstructPoint(XCoordinate=X_2, YCoordinate=Y_2, ZCoordinate=Z_2)
load_robot_system = LoadRobotSystem(Name=list_2, Base=construct_point)
load_robot_system_2 = LoadRobotSystem(Name=list, Base=construct_point_2)
robot_2_position = Point(construct_point_2)
robot_1_position = Point(construct_point)
number_slider = Slider(0, range=0..10)
panel = Panel("""0
1""")
mesh_sphere = MeshSphere(Base=PlaneXY(0, 0, 0), Radius=Slider(0, range=0..1000), UCount="3", VCount="3")
construct_point_3 = ConstructPoint(XCoordinate=Slider(701, range=0..1000), YCoordinate="-315", ZCoordinate=Slider(1796, range=0..10000))
number_slider_2 = Slider(0, range=0..10)
mesh_sphere_2 = MeshSphere(Base=construct_point_3, Radius=Slider(50, range=0..1000), UCount="3", VCount="3")

# ---- group: HOLOFAB
ip_address = Panel("192.168.1.137")
create_connection = CreateConnection(Address=ip_address)
robot = ValueList({"Choose Robot", "KR150-2_110", "IRB140", "IRB120"}, selected="IRB120")
robot_2 = ValueList({"Choose Robot", "KR150-2_110", "IRB140", "IRB120"}, selected="IRB140")
robot_2_position_2 = Point(robot_2_position)
robot_1_position_2 = Point(robot_1_position)
connection = Data(create_connection)
stack_trees = StackTrees(Data0=robot_1_position_2, Data1=robot_2_position_2, Reduce=True)
stack_trees_2 = StackTrees(Data0=robot_2, Data1=robot, Reduce=True)  # -> flatten(Tree)
connection_2 = Data(create_connection)
xy_plane_2 = XYPlane(Origin=stack_trees)  # -> flatten(Plane)

# ----
ui_receiver = UIReceiver(Connect=create_connection)  # -> Toggles, Counters, Sliders
bool_values = Boolean(ui_receiver.Toggles)
float_values = Number(ui_receiver.Sliders)
panel_2 = Panel(float_values)
joint_values_from_holofab = Number(float_values)
joint_values_0_to_1 = Number(joint_values_from_holofab)

# ---- group: Condition Joint Values
pi = Pi(Factor="2")
remap_numbers = RemapNumbers(Value=joint_values_0_to_1, Source=Domain(0, 1), Target=pi)  # -> Mapped, Clipped
split_list = SplitList(List=remap_numbers.Mapped, Index="6")  # -> ListA, ListB
text = Text(split_list.ListA)
text_join = TextJoin(Text=text, Join=",")

# ----
holofab_bool_values = Boolean(bool_values)
list_item = ListItem(List=holofab_bool_values, Index=0, Wrap=True)
connection_3 = Data(create_connection)
mesh_streaming = MeshStreaming(Mesh=mesh_sphere, Color=RGB(255, 0, 0), Connect=connection)
connection_4 = Data(create_connection)
mesh_streaming_2 = MeshStreaming(Mesh=mesh_sphere_2, Color=RGB(255, 0, 0), Connect=connection_4)

# ---- group: Results
tool_mesh_2 = Mesh(mesh_brep)
joints_encoded = Text(text_join)
robot_switch = Boolean(list_item)

# ----
stream_gate = StreamGate(Stream=joints_encoded, Gate=robot_switch)  # -> Target0, Target1
data_recorder = DataRecorder(stream_gate.Target0, DataLimit=1, RecordData=True)
data_recorder_2 = DataRecorder(stream_gate.Target1, DataLimit=1, RecordData=True)
joints = Text(data_recorder_2)
joints_2 = Text(data_recorder)

# ---- group: Robot 2
create_target = CreateTarget(Joints=joints, Tool=create_tool.Tool, IsCartesian=False)
create_program = CreateProgram(Name="DefaultProgram", RobotSystem=load_robot_system_2, Targets1=create_target, StepSize=1)  # -> Program, Code, Duration, Warnings, Errors
program_simulation = ProgramSimulation(Program=create_program.Program, Time="0", Normalized=True)  # -> SystemMeshes, JointRotations, Plane, Index, Time, Program, Errors

# ---- group: Robot 1
create_target_2 = CreateTarget(Joints=joints_2, Tool=create_tool.Tool, IsCartesian=False)
create_program_2 = CreateProgram(Name="DefaultProgram", RobotSystem=load_robot_system, Targets1=create_target_2, StepSize=1)  # -> Program, Code, Duration, Warnings, Errors
program_simulation_2 = ProgramSimulation(Program=create_program_2.Program, Time="0", Normalized=True)  # -> SystemMeshes, JointRotations, Plane, Index, Time, Program, Errors

# ----
target = Panel(create_target)
target_2 = Panel(create_target_2)

# ---- group: Results (continued)
joint_rotation_values = Number(program_simulation.JointRotations)
robot_mesh = Mesh(program_simulation.SystemMeshes)
joint_rotation_values_2 = Number(program_simulation_2.JointRotations)
robot_mesh_2 = Mesh(program_simulation_2.SystemMeshes)

# ----
joint_rotation_values_3 = Panel(joint_rotation_values)
custom_preview = CustomPreview(Geometry=robot_mesh, Material=ColourSwatch(SwatchColor=RGB(255, 255, 255)))
joint_rotation_values_4 = Panel(joint_rotation_values_2)
custom_preview_2 = CustomPreview(Geometry=robot_mesh_2, Material=ColourSwatch(SwatchColor=RGB(255, 255, 255)))

# ---- group: HOLOFAB (continued)
joint_rotation_values_5 = Number(joint_rotation_values)
joint_rotation_values_6 = Number(joint_rotation_values_2)
stack_trees_3 = StackTrees(Data0=joint_rotation_values_6, Data1=joint_rotation_values_5, Reduce=True)
tool_mesh_3 = Mesh(tool_mesh_2)
joint_rotation_values_7 = Number(stack_trees_3)
holobot = HoloBot(Name=stack_trees_2, EndEffector=tool_mesh_3, ID=panel, Plane=xy_plane_2)  # -> flatten(HoloBot)
robot_streaming = RobotStreaming(HoloBotS=holobot, Connect=connection)  # disabled
robot_controller = RobotController(HoloBot=holobot, AxisValues=joint_rotation_values_7, Connect=connection_2)
