# Grasshopper definition HoloFab_Example_Robots_Simple.gh (Grasshopper 1.0.7)
# plug-ins: Robots, HoloFab, Mesh Pipe

# ---- group: Inputs
list = ValueList({"AA-KR60", "AA-KR30", "AA-KR60_KR30", "AARCH IRB120", "AARCH IRB6620", "AAU-Utzon-UR10", "Automata", "Bartlett-IRB120", "Bartlett-IRB1600", "Bartlett-KR6"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}, selected="iaac-IRB140")
tool_base_radius = Slider(32, range=0..100)
tool_height = Slider(83, range=0..100)
target_curve = Curve(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)
interpolation_resolution = Slider(100, range=0..100)
progress = Slider(0, range=0..1)
trail_percentage = Slider(0.5, range=0..1)

# ---- group: cREATE tOOL
cone = Cone(Base=PlaneXY(0, 0, 0), Radius=tool_base_radius, Length=tool_height)  # -> Cone, Tip
xy_plane = XYPlane(Origin=cone.Tip)
mesh_brep = MeshBrep(
    Brep=cone.Cone,
    Settings={GridMaxCount=0, GridMinCount=16, JaggedSeams=False, MaxEdgeLength=0, MinEdgeLength=0.0001, MinTolerance=0, Refine=True, RefineAngle=0, RelativeTolerance=0.65, SimplePlanes=True, Tolerance=0})
tool_mesh = Mesh(mesh_brep)
create_tool = CreateTool(Name="DefaultGHTool", TCP=xy_plane, Weight=0, Mesh=tool_mesh)  # -> Tool, TCP

# ----
load_robot_system = LoadRobotSystem(Name=list, Base=PlaneXY(0, 0, 0))

# ---- group: Prepare Tool Program From Curve
divide_curve = DivideCurve(Curve=target_curve, Count=interpolation_resolution, Kinks=False)  # -> Points, Tangents, Parameters
construct_point = ConstructPoint(XCoordinate=0, YCoordinate=0, ZCoordinate=0)
vector_2pt = Vector2Pt(PointA=divide_curve.Points, PointB=construct_point, Unitize=invert(False))  # -> Vector, Length
negative = Negative(Value=vector_2pt.Vector)
plane_normal = PlaneNormal(Origin=divide_curve.Points, ZAxis=negative)
list_2 = ValueList({"Joint", "Linear"}, selected="Linear")
speed = Panel("10")
zone = Panel("100")
create_target = CreateTarget(Plane=plane_normal, Motion=list_2, Tool=create_tool.Tool, Speed=speed, Zone=zone, IsCartesian=True)
create_program = CreateProgram(Name="DefaultProgram", RobotSystem=load_robot_system, Targets1=create_target, StepSize=1)  # -> Program, Code, Duration, Warnings, Errors

# ----
target_curve_2 = Curve(target_curve)
length = Length(Curve=target_curve_2)
program_simulation = ProgramSimulation(Program=create_program.Program, Time=progress, Normalized=True)  # -> SystemMeshes, JointRotations, Plane, Index, Time, Program, Errors
multiplication = Multiplication(A=length, B=trail_percentage)
trail = SimpleTrail(Program=program_simulation.Program, Length=multiplication, MechanicalGroup=0)

# ---- group: Results
tool_mesh_2 = Mesh(mesh_brep)
joint_rotation_values = Number(program_simulation.JointRotations)
robot_mesh = Mesh(program_simulation.SystemMeshes)
trail_2 = Curve(trail)

# ----
gene_pool = GenePool(Decimals=3, Maximum=1, Minimum=0, Value=[0.791, 1, 0.325, 0.696, 0.5, 0.5])
joint_rotation_values_2 = Panel(joint_rotation_values)
custom_preview = CustomPreview(Geometry=robot_mesh, Material=ColourSwatch(SwatchColor=RGB(255, 255, 255)))
pi = Pi(Factor=gene_pool)
trail_3 = Curve(trail_2)
target_curve_3 = Curve(target_curve)
construct_point_2 = ConstructPoint(XCoordinate=Slider(0, range=0..100), YCoordinate=0, ZCoordinate=0)

# ---- group: HOLOFAB
ip_address = Panel("192.168.1.137")
create_connection = CreateConnection(Address=ip_address)
robot = ValueList({"Choose Robot", "KR150-2_110", "IRB140", "IRB120"}, selected="IRB140")
connection = Data(create_connection)
tool_mesh_3 = Mesh(tool_mesh_2)
connection_2 = Data(create_connection)
joint_rotation_values_3 = Number(joint_rotation_values)
curve = Curve(trail_3)
accuracy_along = Slider(0.2, range=0..1)
sides = Slider(3, range=0..10)
holobot = HoloBot(Name=robot, EndEffector=tool_mesh_3, ID=0, Plane=construct_point_2)
mesh_pipe = MeshPipe(Curve=curve, Radius=5, Accuracy=accuracy_along, Rotation=0, Segments=sides, Caps="0")
robot_controller = RobotController(HoloBot=holobot, AxisValues=joint_rotation_values_3, Connect=connection_2)
robot_streaming = RobotStreaming(HoloBotS=holobot, Connect=connection)
path_visualization = Mesh(mesh_pipe)
colour_swatch = ColourSwatch(SwatchColor=RGB(255, 0, 0))
connection_3 = Data(create_connection)
mesh_streaming = MeshStreaming(Mesh=path_visualization, Color=colour_swatch, Connect=connection_3)

# ----
connection_4 = Data(create_connection)
mesh_sphere = MeshSphere(Base=PlaneXY(0, 0, 0), Radius=Slider(50, range=0..100), UCount=10, VCount=20)
mesh_streaming_2 = MeshStreaming(Mesh=mesh_sphere, Color=RGB(255, 0, 0), Connect=connection_4)
custom_preview_2 = CustomPreview(Geometry=path_visualization, Material=colour_swatch)
